# Grasshopper definition gh_radiation_plotter.gh (Grasshopper 1.0.7)

panel = Panel("clt_2_radiation_r001.obj")
number_slider = Slider(0, range=0..160)
number_slider_2 = Slider(7.557, range=0..10)
number_slider_3 = Slider(17, range=0..100)
number_slider_4 = Slider(14.38, range=0..20)
load_structure = GhPythonScript(file="flat_mesh_20x20_radiation_t10.obj")  # -> out, structure
# ---------- load_structure: Python ----------
__author__ = "tmendeze"

import os
import compas_vibro
from compas_vibro.structure import Structure

fp = os.path.join(compas_vibro.DATA, file)
structure = Structure.from_obj(fp)
# ---------- end load_structure ----------
num_modes = Slider(10, range=0..10)
panel_2 = Panel(load_structure.out)
harmonic_s_plotter = GhPythonScript(structure=load_structure.structure, mode=number_slider, scale=number_slider_3, move_y=number_slider_2)  # -> out, mesh, string, norm; inputs mode: Int32
# ---------- harmonic_s_plotter: Python ----------
__author__ = "tmendeze"

import os
import compas_vibro
import rhinoscriptsyntax as rs
from compas.geometry import length_vector
from compas.utilities import i_to_rgb


ekeys = sorted(structure.elements.keys())
faces = [structure.elements[ek].nodes for ek in ekeys]

f = structure.results['harmonic'][mode].frequency
vertices = []
dm = []
nodes = sorted(structure.nodes.keys(), key=int)
scale *= 1e7
for vk in nodes:
    x, y, z = structure.nodes[vk].xyz()
    y -= move_y
    dx = structure.results['harmonic'][mode].displacements[vk]['real']['x']
    dy = structure.results['harmonic'][mode].displacements[vk]['real']['y']
    dz = structure.results['harmonic'][mode].displacements[vk]['real']['z']
    
    xyz = [x + dx * scale, y + dy * scale, z + dz * scale]
    dm.append(length_vector([dx, dy, dz]))
    vertices.append(xyz)

m = min(dm)
M = max(dm)
colors = [i_to_rgb((z-m)/(M-m)) for z in dm]
ilist = [(z-m)/(M-m) for z in dm]

mesh = rs.AddMesh(vertices, faces, vertex_colors=colors)

string = 'Frequency {} Hz'.format(f)

ks = structure.results['harmonic'][mode].modal_coordinates.keys()
norm = []
for k in ks:
    if k != 'f':
        n = structure.results['harmonic'][mode].modal_coordinates[k]['norm']
        norm.append((n, k))

norm = sorted(norm)[::-1]
# ---------- end harmonic_s_plotter ----------
vec = VectorXYZ(XComponent=0, YComponent=expr("-x - 1", number_slider_2), ZComponent=0)  # -> Vector, Length
vec_2 = VectorXYZ(XComponent=0, YComponent=expr("-x - 1", number_slider_4), ZComponent=0)  # -> Vector, Length
plot_rad_curve = GhPythonScript(structure=load_structure.structure, mode=number_slider)  # -> out, curve, a
# ---------- plot_rad_curve: Python ----------
__author__ = "tmendeze"
__version__ = "2021.07.08"

import rhinoscriptsyntax as rs
import math

pts = []
for rk in structure.results['radiation']:
    f = structure.results['radiation'][rk].frequency
    w = structure.results['radiation'][rk].radiated_p
    w = (10 * math.log10(w)) + 120
    pts.append([f, w, 0])
curve = rs.AddPolyline(pts)
f = structure.results['radiation'][mode].frequency
w = structure.results['radiation'][mode].radiated_p
w = (10 * math.log10(w)) + 120
a = rs.AddCircle([f, w, 0], 1)
# ---------- end plot_rad_curve ----------
plot_rad_mesh = GhPythonScript(structure=load_structure.structure, mode=number_slider, scale=number_slider_3, move_y=number_slider_4)  # -> out, curve, mesh, string
# ---------- plot_rad_mesh: Python ----------
__author__ = "tmendeze"
__version__ = "2021.07.08"

import rhinoscriptsyntax as rs
import math
import os
import compas_vibro
from compas.geometry import length_vector
from compas.utilities import i_to_rgb
from compas_vibro.vibro.utilities import radiating_faces


f = structure.results['radiation'][mode].frequency
W = structure.results['radiation'][mode].radiated_p_faces
w = structure.results['radiation'][mode].radiated_p
w = round((10 * math.log10(w)) + 120, 2)

################################################################################

eks = radiating_faces(structure)
faces = [structure.elements[ek].nodes for ek in eks]


f = structure.results['harmonic'][mode].frequency
vertices = []
#dm = []
nodes = sorted(structure.nodes.keys(), key=int)
scale *= 1e7
for vk in nodes:
    x, y, z = structure.nodes[vk].xyz()
    y -= move_y
    dx = structure.results['harmonic'][mode].displacements[vk]['real']['x']
    dy = structure.results['harmonic'][mode].displacements[vk]['real']['y']
    dz = structure.results['harmonic'][mode].displacements[vk]['real']['z']
    
    xyz = [x + dx * scale, y + dy * scale, z + dz * scale]
#    dm.append(length_vector([dx, dy, dz]))
    vertices.append(xyz)
Wlist = [W[k] for k in W]
m = min(Wlist)
M = max(Wlist)
colors = [i_to_rgb((z-m)/(M-m)) for z in Wlist]

vertices_ = []
faces_ = []
count = 0
vertex_colors = [] 
for i, f in enumerate(faces):
    face = []
    for vk in f:
        vertices_.append(vertices[vk])
        face.append(count)
        count += 1
        vertex_colors.append(colors[i])
    faces_.append(face)

mesh = rs.AddMesh(vertices_, faces_, vertex_colors=vertex_colors)

string = 'Radiated Power {} dB'.format(w)
# ---------- end plot_rad_mesh ----------
modal_plotter = GhPythonScript(
    structure=load_structure.structure,
    norm=harmonic_s_plotter.norm,
    scale=Slider(20, range=0..100),
    move_x=Slider(5.96, range=0..10),
    num_modes=num_modes)  # -> out, meshes, strings, pts; inputs norm: list, num_modes: Int32
# ---------- modal_plotter: Python ----------
__author__ = "tmendeze"

import os
import compas_vibro
import rhinoscriptsyntax as rs
from compas.geometry import length_vector
from compas.utilities import i_to_rgb

modes = [n[1] for n in norm]
factors = [n[0] for n in norm]

ekeys = sorted(structure.elements.keys())
faces = [structure.elements[ek].nodes for ek in ekeys]


meshes = []
strings = []
pts = []
for i, mode in enumerate(modes[:num_modes]):
    vertices = []
    dm = []
    nodes = sorted(structure.nodes.keys(), key=int)
    factor = factors[i]
    f = structure.results['modal'][mode].frequency
    for vk in nodes:
        x, y, z = structure.nodes[vk].xyz()
        x += move_x * i
        dx = structure.results['modal'][mode].displacements['ux'][vk]
        dy = structure.results['modal'][mode].displacements['uy'][vk]
        dz = structure.results['modal'][mode].displacements['uz'][vk]
        xyz = [x + dx * scale, y + dy * scale, z + dz * scale]
        dm.append(length_vector([dx, dy, dz]))
        vertices.append(xyz)
    
    m = min(dm)
    M = max(dm)
    colors = [i_to_rgb((z-m)/(M-m)) for z in dm]
    ilist = [(z-m)/(M-m) for z in dm]
    
    mesh = rs.AddMesh(vertices, faces, vertex_colors=colors)
    meshes.append(mesh)
    string = 'Mode {} - {} Hz - {} factor'.format(mode, round(f, 2), round(factor, 3))
    strings.append(string)
    pts.append(rs.AddPoint(move_x * i, -1, 0))
# ---------- end modal_plotter ----------
tag = TextTag3D(Location=vec.Vector, Text=harmonic_s_plotter.string, Size=Slider(0.5, range=0..1), Justification=7)
panel_3 = Panel(harmonic_s_plotter.out)
pt = Point(Point(0, -1, 0))
tag_2 = TextTag3D(Location=vec_2.Vector, Text=plot_rad_mesh.string, Size=Slider(0.3, range=0..1), Justification=7)
mesh = Mesh(modal_plotter.meshes)
panel_4 = Panel(plot_rad_mesh.out)
tag_3 = TextTag3D(Location=modal_plotter.pts, Text=modal_plotter.strings, Size=Slider(0.26, range=0..1), Justification=7)
